# Grasshopper definition _portal-overview.gh (Grasshopper 1.0.7)
# plug-ins: Portal, Bifocals

# ----
# Metadata add additional information for each geometry
panel = Panel("Some Prop")
# Metadata
panel_2 = Panel("Some Point")
srmeta = SerializeMetadata(Name=panel_2, OtherProp=panel)
pt = Point([Point(6.052849799, -3.32025256, 0), Point(-0.3525931922, -0.9108657465, 0), Point(-4.936304691, -1.145927875, 0)])

# ----
# You can add as many metadata as you need to each geometry
panel_3 = Panel("Some Prop")
srmeta_2 = SerializeMetadata(Name="Some Mesh", OtherProp=panel_3)
panel_4 = Panel(srmeta_2)

# ----
# Portal 0.3.1
# Byte Conversion
# Direct conversion
panel_5 = Panel("this is a string")
bytes = Bytes(panel_5)
panel_6 = Panel(bytes)

# ----
# Mesh Vertex Color
# Optionally vertex color can be serialized and send as part
# of the packet. Defaults empty list.
mesh = Mesh(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)
mcol = MeshColours(Mesh=mesh, Colours=ColourSwatch(SwatchColor=RGB(255, 255, 255)))
srmesh = SerializeMesh(Mesh=mcol)

srpt = SerializePoints(Points=pt, Metadata=srmeta)
panel_7 = Panel(srmeta)
pack = PackPayload(Payloads=srpt, isBeautify=True)
payload = Panel(srmesh)
# Memory Mapped File: Description:
# Memory-Mapped Files map a portion of memory to the address space of a process for efficient inter-process communication (IPC).
# 
# Usage:
# - Ideal for extremely fast read and write operations directly in shared memory.
# 
# Warning:
# - Limited to the local machine.
# - May cause data corruption, memory leaks, or program crashes if not handled properly.
payload_2 = Panel(pack)
trigger = Trigger(Interval=100, TimerInterval=100, Target=mmf_2)  # disabled

# ----
# Point Serialization
pt_2 = Point([Point(2.174324685, -5.670873841, 0), Point(6.052849799, -3.32025256, 0), Point(-0.3525931922, -0.9108657465, 0), Point(-4.936304691, -1.145927875, 0), Point(-7.463222568, -5.141984053, 0), Point(-1.057779577, -8.080260655, 0), Point(6.111615331, -8.315322783, 0), Point(0.9402485125, -5.494577245, 0), Point(-1.880497025, -2.438769579, 0), Point(2.585683409, 2.908893836, 0), Point(-5.347663415, 5.729639373, 0), Point(-9.872609382, 3.379018092, 0), Point(-13.16347918, -1.557286599, 0), Point(-16.10175578, -5.905935969, 0), Point(-11.75310641, -8.961743635, 0), Point(-5.700256607, -9.490633423, 0)])
srpt_2 = SerializePoints(Points=pt_2)

# ----
# Mesh Serialization
mesh_2 = Mesh(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)
srmesh_2 = SerializeMesh(Mesh=mesh_2)

# ----
# Curve Serialization
crv = Curve(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)
srcrv = SerializeCurve(Curves=crv)

# ----
# Network Informations
info = NetworkInfo()  # -> Properties, LocalIP
panel_8 = Panel(info.Properties)
your_main_local_ip = Panel(info.LocalIP)

serialized_points = Panel(srmesh_2)
serialized_points_2 = Panel(srpt_2)
serialized_curve = Panel(srcrv)

# ----
# Mesh Deserialization
dsrmesh = DeserializeMesh(Payload=srmesh_2)  # -> Mesh, Metadata
deserialized_mesh = Panel(dsrmesh.Mesh)

# ----
# Point Deserialization
dsrpt = DeserializePoints(Payload=srpt_2)  # -> Point, Metadata
deserialized_points = Panel(dsrpt.Point)

# ----
# Curve Deserialization
dsrcrv = DeserializeCurve(Payload=srcrv)  # -> Curve, Metadata
deserialized_curve = Panel(dsrcrv.Curve)

# ----
# It can be be individually set by a list
# Blender field mappings:
# - Name: Sets the name of the Blender object.
# - Material: Associates the Blender object with a material by matching names.
panel_9 = Panel("Glass")
pt_3 = Point([Point(6.052849799, -3.32025256, 0), Point(-0.3525931922, -0.9108657465, 0), Point(-4.936304691, -1.145927875, 0)])
srmeta_3 = SerializeMetadata(Name="PointA", Material="Wood")
srmeta_4 = SerializeMetadata(Name="PointB", Material=panel_9)

merge = Merge(Data1=srmeta_3, Data2=srmeta_4)
srpt_3 = SerializePoints(Points=pt_3, Metadata=merge)

pack_2 = PackPayload(Payloads=srpt_3, isBeautify=True)

payload_3 = Panel(pack_2)

# ----
# Encoder conversion
panel_10 = Panel("this is a string")
enb = BytesEncoder(Text=panel_10, Compress=False)

bytes_2 = Bytes(enb)

panel_11 = Panel(bytes_2)

# ----
# Cannot convert other than string
mesh_3 = Mesh(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)

bytes_3 = Bytes(mesh_3)

panel_12 = Panel(bytes_3)

# ----
# Need to serialize geometry and pack a payload before sending
mesh_4 = Mesh(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)
srmesh_3 = SerializeMesh(Mesh=mesh_4)
pack_3 = PackPayload(Payloads=srmesh_3, isBeautify=False)

bytes_4 = Bytes(pack_3)

panel_13 = Panel(bytes_4)

# ----
# WebSockets
# Named Pipe: Description:
# Named Pipes allow inter-process communication (IPC) through a unidirectional pipe.
# 
# Usage:
# - Useful for scenarios requiring fast, reliable, ordered, and byte-stream-based communication.
# 
# Warning:
# - Limited to local machine
panel_14 = Panel("something")
# Websockets: Description:
# Websockets provide a stable connection, capable of handling large payloads.
# 
# Usage:
# - Best for large, content-critical payloads where data integrity is crucial.
# - Suitable for both local and cross-machine communication.
# 
# Warning:
# - Slower transmission speed.
# - Requires the server to start first to establish a connection.
panel_15 = Panel("abc")
srmeta_5 = SerializeMetadata(Name=panel_15, Material="wood", Others=panel_14)
mesh_5 = Mesh(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)
srmesh_4 = SerializeMesh(Mesh=mesh_5, Metadata=srmeta_5)
number_slider = Slider(6001, range=0..10000)
ws_server = WebSocketServer(Port=number_slider, Route="/test", Start=Toggle(False))
deb = BytesDecoder(Bytes=ws_server)

pack_4 = PackPayload(Payloads=srmesh_4, isBeautify=False)
unpack = UnpackPayload(JsonString=deb)
dsrmesh_2 = DeserializeMesh(Payload=unpack)  # -> Mesh, Metadata
dsrmeta = DeserializeMetadata(Json=dsrmesh_2.Metadata)  # -> Name, Material, Others

enb_2 = BytesEncoder(Text=pack_4, Compress=Toggle(True))
ws_client = WebSocketClient(HostIP="127.0.0.1", Port=number_slider, Route="/test", Bytes=enb_2, Send=Button())
panel_16 = Panel(dsrmesh_2.Mesh)
panel_17 = Panel(dsrmeta.Others)

# ----
# Serialization: Description:
# Serialize geometry to a JSON string with common properties, enabling receivers to understand and reconstruct the geometry. The serialized data is generic and not platform-specific.
# 
# Usage:
# - Facilitates the transmission and reconstruction of geometry data across different programs.
panel_18 = Panel(dsrmeta.Material)
panel_19 = Panel(dsrmeta.Name)

# ----
# UDP
# UDP: Description:
# UDP provides fast, connectionless transmission.
# 
# Usage:
# - Ideal for payloads under 1472 bytes needing quick, straightforward transmission without connection setup or integrity checks (e.g., sending small instructions).
# - Supports cross-machine communication.
# 
# Warning:
# - Not suitable for payloads over 1472 bytes.
# - Data may become corrupted due to fragmentation.
number_slider_2 = Slider(6000, range=0..10000)
udp = UDPSender(ServerIP="127.0.0.1", Port=number_slider_2, Bytes="hey there from client", Send=Button())
udp_2 = UdpReceiver(Port=number_slider_2, Start=Toggle(False))

deb_2 = BytesDecoder(Bytes=udp_2)

panel_20 = Panel(deb_2)

# ----
# File I/O: Description:
# File I/O operations allow reading from and writing to files on a storage device.
# 
# Usage:
# - Suitable for scenarios requiring persistent storage of data.
# 
# Warning:
# - Limited to the local machine.
# - Disk I/O operations can be slow compared to memory operations.
# File I/O
panel_21 = Panel("hey there from grasshopper")
file = FileWriter(Bytes=panel_21, FilePath="D:\test.txt", Write=Button())
file_2 = FileReader(FilePath="D:\test.txt")

deb_3 = BytesDecoder(Bytes=file_2)

panel_22 = Panel(deb_3)

# ----
# Named Pipe
panel_23 = Panel("hey there from pipe ")
pipe = PipeSender(PipeName="TestPipe", Bytes=panel_23, Send=Toggle(False))
pipe_2 = PipeReceiver(PipeName="TestPipe", Start=Toggle(False))

deb_4 = BytesDecoder(Bytes=pipe_2)

panel_24 = Panel(deb_4)

# ----
# Memory Mapped File
panel_25 = Panel("hey there from mmf ")
mmf = SharedMemoryWriter(MemoryName="TestMemoryBlock", Bytes=panel_25, Write=Toggle(False))

mmf_2 = SharedMemoryReader(MemoryName="TestMemoryBlock")
deb_5 = BytesDecoder(Bytes=mmf_2)

panel_26 = Panel(deb_5)

# ----
# Encryption: Description:
# Encrypt binary data using the AES symmetric encryption algorithm with a password.
# 
# Usage:
# - Secure data transmission for cross-machine communication.
# 
# Warning:
# - Encryption and decryption will take additional time.
# Data Encryption
mesh_6 = Mesh(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)

srmesh_5 = SerializeMesh(Mesh=mesh_6)
pack_5 = PackPayload(Payloads=srmesh_5, isBeautify=False)

enb_3 = BytesEncoder(Text=pack_5, Compress=Toggle(True), Password="password123")

compressed_encrypted = Panel(enb_3)

# ----
# Mesh Serialization + compression
# Compression: Description:
# Compress binary data using the GZip algorithm.
# 
# Usage:
# - Ideal for transmitting large data as it reduces payload size, bandwidth, and memory usage, while increasing transmission speed.
# 
# Warning:
# - Not suitable for small data as it may increase the size.
mesh_7 = Mesh(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)

srmesh_6 = SerializeMesh(Mesh=mesh_7)
pack_6 = PackPayload(Payloads=srmesh_6, isBeautify=False)

enb_4 = BytesEncoder(Text=pack_6, Compress=False)
enb_5 = BytesEncoder(Text=pack_6, Compress=Toggle(True))

uncompressed = Panel(enb_4)
compressed = Panel(enb_5)

# ----
# Data Decryption
panel_27 = Panel("password123")
deb_6 = BytesDecoder(Bytes=enb_3, Password=panel_27)

unpack_2 = UnpackPayload(JsonString=deb_6)
dsrmesh_3 = DeserializeMesh(Payload=unpack_2)  # -> Mesh, Metadata

panel_28 = Panel(dsrmesh_3.Mesh)

# ----
# Mesh Deserialization + decompression
deb_7 = BytesDecoder(Bytes=enb_5)

unpack_3 = UnpackPayload(JsonString=deb_7)
dsrmesh_4 = DeserializeMesh(Payload=unpack_3)  # -> Mesh, Metadata

panel_29 = Panel(dsrmesh_4.Mesh)
