# Grasshopper definition gh-blender-memory-mapped-file.gh (Grasshopper 1.0.7)
# plug-ins: Bifocals, Portal

trigger = Trigger(Interval=10, TimerInterval=10, Target=objmeta)  # disabled

# ---- group: Reference Geometry
# Portal GH == 0.4.0+
# Portal Blender == 0.1.0+
# Grasshopper -> Blender: Memory Mapped File
mesh_frame = Mesh([<mesh referenced from the Rhino model> x2])

# ----
objmeta = ObjectMeta(Geometry=mesh_frame)  # -> Id, Layer, Material
srmeta = SerializeMetadata(Id=objmeta.Id, Layer=objmeta.Layer, Material=objmeta.Material)
panel = Panel(srmeta)
srgeo = SerializeGeometry(Geometry=mesh_frame, Metadata=srmeta)
# Pack data and metadata into a
#  single string before encoding
# as bytes for transmission.
pack = PackPayload(Payloads=srgeo, isBeautify=False)
enb = BytesEncoder(Text=pack, Compress=Toggle(True))
# Blender Server
mmf = SharedMemoryWriter(MemoryName="channel-1", Bytes=enb, Write=Toggle(False))
