# Grasshopper definition gh-blender-pipe (basic).gh (Grasshopper 1.0.7)
# plug-ins: Portal, Bifocals

# ---- group: Input 1
# Portal GH == 0.3.1
# Portal Blender == 0.0.3
mesh_frame = Mesh(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)

# ----
# Pack data and metadata into a
#  single string before encoding
# as bytes for transmission.
srmesh = SerializeMesh(Mesh=mesh_frame)
pack = PackPayload(Payloads=srmesh, isBeautify=False)
# Blender Server
pipe = PipeSender(PipeName="testpipe", Bytes=pack, Send=Toggle(False))
