# Grasshopper definition gh-blender-udp.gh (Grasshopper 1.0.7)
# plug-ins: Bifocals, Portal

panel = Panel("message to blender. This message can only be read in blender console. UDP Server only accept data under 1472 bytes.")
# Portal GH == 0.3.1
# Portal Blender == 0.0.3
# Grasshopper -> Blender: UDP
number_slider = Slider(8765, range=0..10000)
# Blender Server
udp = UDPSender(ServerIP="127.0.0.1", Port=number_slider, Bytes=panel, Send=Toggle(False))
