# Grasshopper definition websocket-example.gh (Grasshopper 1.0.7)
# plug-ins: NetworkGh

number_slider = Slider(6000, range=0..10000)
ws_client = WebSocketClient(HostIP="127.0.0.1", EndPoint="/", Connect=Toggle(False))
python = GhPythonScript()  # -> value, timestamp
# ---------- python: Python ----------
import rhinoscriptsyntax as rs
import json

json_data = json.loads(data)
value = json_data["probability"]
timestamp = json_data["timestamp"]
# ---------- end python ----------
udp = UDPSender(ServerIP="127.0.0.1", Port=number_slider, Message="hey there from client 4", Send=Button())
info = NetworkInfo()  # -> Properties, LocalIP
number_slider_2 = Slider(6000, range=0..10000)
panel = Panel(info.Properties)
udp_2 = UdpReceiver(Port=number_slider, Start=Toggle(False))
ws_client_2 = WebSocketClient(HostIP="127.0.0.1", Port=number_slider_2, Route="/test", Connect=Button())
panel_2 = Panel(ws_client_2)
panel_3 = Panel(udp_2)
ws_server = WebSocketServer(Port=number_slider_2, Route="/test", Start=Toggle(False))
pipe = NamedPipeSender(ServerName=".", Message="hey there from client7", Send=Button())
panel_4 = Panel(ws_server)
pipe_2 = NamedPipeReceiver(PipeName="neurosity", BufferSize=4096, Start=Toggle(False))
panel_5 = Panel(pipe_2)
